# Dynamo graph Corridor Barrier Setout - SW.dyn (Dynamo 2.5.2.7915)
# packages: Civil3DToolkit 1.1.19

# group: Usage metric collection
code_block = CodeBlock { "Corridor Barrier Setout"; "0.1.0"; }
usageMetrics = Custom[UsageMetrics](scriptName=code_block.out0, scriptVersion=code_block.out1)  # Tracks run information an uploads to Power BI Database

# group: Get Corridor Feature Lines
corridor_name = CorridorNameDropDown("Corridor")  # graph input
corridor_barrier_code = StringInput("Back_Curb")  # graph input
corridorFeatureLinesByCode = Custom[CorridorFeatureLinesByCode](corridor=corridor_name, code=corridor_barrier_code)  # Returns all corridor feature lines for a given code

barrier_draw_layer = StringInput("Barrier")  # graph input

# group: Start Terminal Creation
startStation = Autodesk.Civil.DynamoNodes.CorridorFeatureLine.StartStation(corridorFeatureLine=corridorFeatureLinesByCode)
start_terminal_offset = DoubleSlider(15, range=0..500 step 1)  # graph input
add = startStation + start_terminal_offset
start_terminal_block_name = StringInput("TL3_Terminal")  # graph input
start_terminal_rotation_angle = DoubleInput(0)  # graph input
placeBlocksAlongCorridorFeatureLine = Custom[PlaceBlocksAlongCorridorFeatureLine](corridorFeatureLine=corridorFeatureLinesByCode, station=add, blockName=start_terminal_block_name, blockRotationAngle=start_terminal_rotation_angle, layer=barrier_draw_layer)  # Places specified blocks along corridor feature lines at given station locations

# group: Post Creation
startStation_2 = Autodesk.Civil.DynamoNodes.CorridorFeatureLine.StartStation(corridorFeatureLine=corridorFeatureLinesByCode)
start_post_offset = DoubleSlider(15.5, range=0..500 step 1)  # graph input
add_2 = startStation_2 + start_post_offset
endStation = Autodesk.Civil.DynamoNodes.CorridorFeatureLine.EndStation(corridorFeatureLine=corridorFeatureLinesByCode)
end_post_offset = DoubleSlider(15.5, range=0..500 step 1)  # graph input
sub = endStation - end_post_offset
post_spacing = DoubleSlider(2, range=0..500 step 1)  # graph input
range = Range(start=add_2, end=sub, step=post_spacing)
post_block_name = StringInput("TL3_Post")  # graph input
post_rotation_angle = DoubleInput(0)  # graph input
placeBlocksAlongCorridorFeatureLine_2 = Custom[PlaceBlocksAlongCorridorFeatureLine](corridorFeatureLine=corridorFeatureLinesByCode, station=range, blockName=post_block_name, blockRotationAngle=post_rotation_angle, layer=barrier_draw_layer)

# group: End Terminal Creation
endStation_2 = Autodesk.Civil.DynamoNodes.CorridorFeatureLine.EndStation(corridorFeatureLine=corridorFeatureLinesByCode)
end_terminal_offset = DoubleSlider(15, range=0..500 step 1)  # graph input
sub_2 = endStation_2 - end_terminal_offset
end_terminal_block_name = StringInput("TL3_Terminal")  # graph input
end_terminal_rotation_angle = DoubleInput(180)  # graph input
placeBlocksAlongCorridorFeatureLine_3 = Custom[PlaceBlocksAlongCorridorFeatureLine](corridorFeatureLine=corridorFeatureLinesByCode, station=sub_2, blockName=end_terminal_block_name, blockRotationAngle=end_terminal_rotation_angle, layer=barrier_draw_layer)

# group: Get lists of terminal and post objects
join = List.Join()  # unwired: list0, list1, list2
code_block_2 = CodeBlock { 2; }
flatten = List.Flatten(list=placeBlocksAlongCorridorFeatureLine, amt=code_block_2)
code_block_3 = CodeBlock { 1; }
chop = List.Chop(list=flatten, lengths=code_block_3)
code_block_4 = CodeBlock { 1; }
flatten_2 = List.Flatten(list=placeBlocksAlongCorridorFeatureLine_2, amt=code_block_4)
code_block_5 = CodeBlock { 2; }
flatten_3 = List.Flatten(list=placeBlocksAlongCorridorFeatureLine_3, amt=code_block_5)
code_block_6 = CodeBlock { 1; }
chop_2 = List.Chop(list=flatten_3, lengths=code_block_6)
combine = List.Combine(comb=join, list1=chop, list2=flatten_2, list3=chop_2)

# group: Place Barrier Elements
post_block_name_2 = StringInput("Wire_Rope_Barrier")  # graph input
placeBarrierBlocks = Custom[PlaceBarrierBlocks](blockReferencesToJoin=combine, blockName=post_block_name_2, drawLayer=barrier_draw_layer)

alignments = AlignmentNamesDropDown()  # nothing selected
coordinateSystemByStationOffset = Autodesk.Civil.DynamoNodes.Alignment.CoordinateSystemByStationOffset(alignment=alignments)  # unwired: station
